# Dynamo graph dummy.dyn (Dynamo 3.6.0.9636)

number_slider = DoubleSlider(1, range=0..100 step 0.1)
integer_slider = IntegerSlider(1, range=0..100 step 1)
integer_slider_2 = IntegerSlider(1, range=0..100 step 1)
byCoordinates = Point.ByCoordinates(x=integer_slider, y=integer_slider_2)
custom_selection = CustomSelection("One", items={One: "1", Two: "2", Three: "3"}, IsVisibleDropDownTextBlock=true)
add = Point.Add(point=byCoordinates, vectorToAdd=custom_selection)
subtract = Point.Subtract(point=add)  # unwired: vectorToSubtract
code_block = CodeBlock(x=subtract) { x; }
byPlaneRadius = Circle.ByPlaneRadius(plane=code_block)
byCenterPointRadiusNormal = Circle.ByCenterPointRadiusNormal()
byBestFitThroughPoints = Circle.ByBestFitThroughPoints(points=byCenterPointRadiusNormal)
byCenterPointRadius = Circle.ByCenterPointRadius(centerPoint=byPlaneRadius, radius=byBestFitThroughPoints)
